# Grasshopper definition first test.gh (Grasshopper 1.0.8)
# plug-ins: ProgesiGrasshopperAssembly

progesirepotest = ProgesiRepoRhinoSmoke(Run=Toggle(True), Action="Save", Id="2", Name="Second test", Value=Slider(8, range=0..10))  # -> Ok, Message, Count, Vars
progesirepotest_2 = ProgesiRepoRhinoSmoke(Run=Toggle(True), Action="Save", Id="1", Name="First test", Value=Slider(6, range=0..10))  # -> Ok, Message, Count, Vars
progesirepotest_3 = ProgesiRepoRhinoSmoke(Run=Toggle(True), Action="getall", Id=1, Name="n", Value="42")  # -> Ok, Message, Count, Vars
panel = Panel(progesirepotest_2.Message)
panel_2 = Panel(progesirepotest_3.Vars)
list = ValueList({"Save", "getall", "delete", "reset"}, selected="Save")
list_2 = ValueList({"Save", "getall", "delete", "reset"}, selected="Save")
list_3 = ValueList({"Save", "getall", "delete", "reset"}, selected="Save")
list_4 = ValueList({"Save", "getall", "delete", "reset"}, selected="Save")
list_5 = ValueList({"Save", "getall", "delete", "reset"}, selected="getall")
list_6 = ValueList({"Save", "getall", "delete", "reset"}, selected="Save")
list_7 = ValueList({"Save", "getall", "delete", "reset"}, selected="Save")
path = FilePath("C:\Users\gianl\source\repos\ProgesiGrasshopperAssembly\ProgesiRhinoFakeRepository\ProgesiSqliterepo")
path_2 = FilePath("C:\Users\gianl\source\repos\ProgesiGrasshopperAssembly\ProgesiRhinoFakeRepository\ProgesiSqliterepo")
path_3 = FilePath("C:\Users\gianl\source\repos\ProgesiGrasshopperAssembly\ProgesiRhinoFakeRepository\ProgesiSqliterepo")
brep = Brep(<brep referenced from the Rhino model>)
path_4 = FilePath("C:\Users\gianl\source\repos\ProgesiGrasshopperAssembly\ProgesiRhinoFakeRepository\ProgesiSqliterepo")
path_5 = FilePath("C:\Users\gianl\source\repos\ProgesiGrasshopperAssembly\ProgesiRhinoFakeRepository\ProgesiSqliterepo")
path_6 = FilePath("C:\Users\gianl\source\repos\ProgesiGrasshopperAssembly\ProgesiRhinoFakeRepository\ProgesiSqliterepo")
path_7 = FilePath("C:\Users\gianl\source\repos\ProgesiGrasshopperAssembly\ProgesiRhinoFakeRepository\ProgesiSqliterepo")
srf = Surface(<surface referenced from the Rhino model>)
crv = Curve(<curve referenced from the Rhino model>)
progesisqlitetest = ProgesiRepoSQLiteSmoke(DbPath=path_2, Command=list_7, Id="1", Name="Integer", Value="5")  # -> Ok, Count, Message, Variables
progesisqlitetest_2 = ProgesiRepoSQLiteSmoke(DbPath=path_3, Command=list, Id="2", Name="double", Value="3.1425")  # -> Ok, Count, Message, Variables
progesisqlitetest_3 = ProgesiRepoSQLiteSmoke(DbPath=path_4, Command=list_2, Id="3", Name="String", Value="Oggi Sono Felice")  # -> Ok, Count, Message, Variables
progesisqlitetest_4 = ProgesiRepoSQLiteSmoke(DbPath=path_5, Command=list_3, Id="5", Name="b rep di Rhino - Solido", DependsFrom=brep)  # -> Ok, Count, Message, Variables
progesisqlitetest_5 = ProgesiRepoSQLiteSmoke(DbPath=path_6, Command=list_4, Id="6", Name="Superfice", Value=srf)  # -> Ok, Count, Message, Variables
progesisqlitetest_6 = ProgesiRepoSQLiteSmoke(DbPath=path_7, Command=list_6, Id="4", Name="Curva di Rhino", Value=crv)  # -> Ok, Count, Message, Variables
progesisqlitetest_7 = ProgesiRepoSQLiteSmoke(DbPath=path, Command=list_5, Id=0)  # -> Ok, Count, Message, Variables
panel_3 = Panel(progesisqlitetest.Ok)
panel_4 = Panel(progesisqlitetest.Count)
panel_5 = Panel(progesisqlitetest.Message)
panel_6 = Panel(progesisqlitetest.Variables)
panel_7 = Panel(progesisqlitetest_2.Ok)
panel_8 = Panel(progesisqlitetest_2.Count)
panel_9 = Panel(progesisqlitetest_2.Message)
panel_10 = Panel(progesisqlitetest_2.Variables)
panel_11 = Panel(progesisqlitetest_3.Ok)
panel_12 = Panel(progesisqlitetest_3.Count)
panel_13 = Panel(progesisqlitetest_3.Message)
panel_14 = Panel(progesisqlitetest_3.Variables)
panel_15 = Panel(progesisqlitetest_4.Ok)
panel_16 = Panel(progesisqlitetest_4.Count)
panel_17 = Panel(progesisqlitetest_4.Message)
panel_18 = Panel(progesisqlitetest_4.Variables)
panel_19 = Panel(progesisqlitetest_5.Ok)
panel_20 = Panel(progesisqlitetest_5.Count)
panel_21 = Panel(progesisqlitetest_5.Message)
panel_22 = Panel(progesisqlitetest_5.Variables)
panel_23 = Panel(progesisqlitetest_6.Ok)
panel_24 = Panel(progesisqlitetest_7.Ok)
panel_25 = Panel(progesisqlitetest_6.Count)
panel_26 = Panel(progesisqlitetest_6.Message)
panel_27 = Panel(progesisqlitetest_6.Variables)
panel_28 = Panel(progesisqlitetest_7.Count)
panel_29 = Panel(progesisqlitetest_7.Message)
panel_30 = Panel(progesisqlitetest_7.Variables)
