# Grasshopper definition demo-misto.gh (Grasshopper 1.0.8)
# plug-ins: ProgesiGrasshopperAssembly

metin = ProgesiMetadataIn(Run=Toggle(True), Act="create", Id=0, By="Gm", Info="This is a test")  # -> Id, Hash, Info
varin = ProgesiVariableIn(
    Run=Toggle(True),
    Act="Create",
    Id=0,
    Name="Alfio",
    Value=Slider(250, range=0..1000),
    Unit=Slider(3.14, range=0..10),
    By="Charlotte")  # -> Alfio, Id, Hash, Info
varin_2 = ProgesiVariableIn(
    Run=Toggle(True),
    Act="Create",
    Id=0,
    Name="Pippa con la palla",
    Value=Slider(3.1489, range=0..10),
    Unit=Slider(7.12, range=0..10),
    By="Rodolfa Faustina")  # -> PippaConLaPalla, Id, Hash, Info
panel = Panel(metin.Id)
panel_2 = Panel(metin.Hash)
panel_3 = Panel(metin.Info)
panel_4 = Panel(varin.Alfio)
panel_5 = Panel(varin.Hash)
panel_6 = Panel(varin.Id)
panel_7 = Panel(varin.Info)
panel_8 = Panel(varin_2.PippaConLaPalla)
panel_9 = Panel(varin_2.Id)
panel_10 = Panel(varin_2.Hash)
panel_11 = Panel(varin_2.Info)
metout = ProgesiMetadataOut(Run=Toggle(True), Id="10")  # -> Id, Hash, By, Refs, Snips, LM, Info
panel_12 = Panel(metout.Id)
panel_13 = Panel(metout.Hash)
panel_14 = Panel(metout.By)
panel_15 = Panel(metout.Refs)
panel_16 = Panel(metout.Snips)
panel_17 = Panel(metout.LM)
panel_18 = Panel(metout.Info)
varout = ProgesiVariableOut(Run=Toggle(True), Hash=varin.Hash, Id=0)  # -> Alfio, Hash, Name, Value, Unit, By, LM, Info, Info_2
panel_19 = Panel(varout.Alfio)
panel_20 = Panel(varout.Hash)
panel_21 = Panel(varout.Name)
panel_22 = Panel(varout.Value)
panel_23 = Panel(varout.Unit)
panel_24 = Panel(varout.By)
panel_25 = Panel(varout.LM)
panel_26 = Panel(varout.Info)
panel_27 = Panel("https://chatgpt.com/g/g-p-68ad6332305881918bd0578689cafa31-progesi-new-grasshopper-tools/c/68d7865c-6bdc-8333-ad01-e25babbb05c4")
metin_2 = ProgesiMetadataIn(Run=Toggle(True), Act="Update", Id="10", By="Gm", Info="Update the test", Ref=panel_27)  # -> Id, Hash, Info
panel_28 = Panel(metin_2.Id)
panel_29 = Panel(metin_2.Hash)
panel_30 = Panel(metin_2.Info)
